# Grasshopper definition AIO_python_B2_002.gh (Grasshopper 1.0.7)

# Python
# all-in-one for dummies, John C. Shovic, Phd and Alan Simpson, 2nd Edition, 2021
# Book 2
# Chapter 2
# Controlling the Action
# the doign and the action
# 
# Main Operators for Controlling the Action
# Relational operators
# Comparison operators
# 
# Python Comparison Operators for Decision-Making
# ==
# !=
# <
# >
# <=
# >=
# 
# Python Logical Operators
# and
# or not
# 
# WEB: George Boole
# if then else
# decision control
# if statement
# 
# Making Decisions with if
# 
# if contion: do this
# do this no matter what
# 
# sun = "down"
# if sun == "down": print("Good night")
# print("I am here")
# 
# == is not = (assignment)
# it is equality checking with bool outcome
# condition is true or false
# 
# sun = "up"
# if sun == "down": print("Good night")
# print("I am here")
# 
# indentation is usually PEP 8 ... 4x space
# can be any spacing so long as it is consistent in code block
# 
# if condition:
#     do this
# do this no matter what
# 
# sun = "down"
# if sun == "down":
#     print("Good night!")
# print("I am here")
# 
# i.e. Total Sale
# total = 100
# sales_tax_rate = 0.065
# taxable = True
# if taxable:
#     print(f"Subtotal : ${total:.2f}")
#     sales_tax = total * sales_tax_rate
#     print(f"Sales Tax: ${sales_tax:.2f}")
#     total = total + sales_tax
# print(f"Total      :{total:.2f}")
# 
# if taxable:
# if taxable == True:
# 
# total = 100
# sales_tax_rate = 0.065
# taxable = False
# if taxable:
#     print(f"Subtotal : ${total:.2f}")
#     sales_tax = total * sales_tax_rate
#     print(f"Sales Tax: ${sales_tax:.2f}")
#     total = total + sales_tax
# print(f"Total      :{total:.2f}")
ifstatement = GhPythonScript(TorF=Toggle(True))  # -> out; inputs TorF: Boolean
# ---------- ifstatement: Python ----------
import rhinoscriptsyntax as rs

# must eliminate Python 3.0 f-string info in python 2.7
total = 100
sales_tax_rate = 0.065 
taxable = TorF
if taxable:
    print("Subtotal: " + str(total))
    sales_tax = (total * sales_tax_rate)
    print("Sales Tax: " + str(sales_tax))
    total = (total + sales_tax)
print("Total: " + str(total))
# ---------- end ifstatement ----------
# Adding else to your if logic
panel = Panel(ifstatement)
